% Simulink data dictionary initilialization.sldd

Qin = [2000 2000 3100 3100 3600 3600 4100 4100 4600 4600 5100 5100 5100 5100]
Qin_time = [0 66.6667 83.3333 150 166.6667 233.3333 250 316.6667 333.3333 400 416.6667 483.3333 500 566.6667]

burner = struct(
  length=0.5,
  crossArea=0.08,
  diameter=0.3191538,
  hydrDiameter=0.3191538,
  initTemp=1479,
  initPress=1591629,
  eff=0.985,
  HHV=43100,
  mfDesign=0.1004,
  heatDesign=4262.3314)

chassis = struct(mass=6000)

compressor = struct(
  areaRatio=1,
  PR=17.5,
  PRMaxEff=4.5,
  isentropicEfficiency=0.821,
  refPressure=101325,
  refTemperature=288.15,
  massFlowDesign=4.6122,
  massFlowCorrected=6.443622,
  rpmDesign=44700,
  rpmDesignCorrected=33808.38,
  mechanicalEff=0.99,
  inletArea=0.08,
  outletArea=0.08,
  isentropicEffMax=0.887,
  isentropicEffMin=0.5,
  massFlowMaxEff=3)

coreArea = 0.3
coreDiameter = 0.6180387
coreHydrDiameter = 0.6180387
exhaust = struct(crossArea=0.08)
fixedStepSize = 0.1
g = 9.81
height = 0
initConditions = struct(rho=1.225, rpm=44700)
inlet = struct(crossArea=0.08)
ix = 8
measSigNames = {"Altitude (m)", "Qin (kW)", "AirMassFlow (kg/s)", "FPT (rpm)", "GGT (rpm)", "Power  (kW)", "T3 (K)", "P2 (Pa)"}

nozzle = struct(
  PR=1.0142,
  massFlowDesign=4.727505,
  isentropicEfficiency=0.9,
  refPressure=101325,
  refTemperature=288.15,
  inletArea=0.08,
  outletArea=0.08,
  massFlowCorrected=7.706857,
  damping=0.001)

rom = struct(
  mean=[1359.222 3970.386 5.224627 19326.41 32683.25 1306.923 1304.285 1205133],
  std=[1502.273 1102.398 0.7006288 2742.896 1124.645 495.651 149.6053 214412.8],
  init=[-0.904777 -1.787363 -1.853786 -1.922634 -1.970208 -1.679336 -1.837937 -1.864608],
  timeColdStart=20)

rotor = struct(
  mass=907,
  diameter=8.178,
  bladeNum=4,
  inertia2blades=2527.495,
  inertia=5054.989,
  powerCoeff=0.43,
  thrustCoeff=0.8,
  rpm=257,
  area=52.52718)

rotorDamping = 0.001
sampleTime = 0.1
shaft = struct(inertia=0.0001, damping=0.001)
shaftDamping = 1.0e-5
shaftFTP = struct(GearRatio=80.5)

turbine = struct(
  areaRatio=1,
  PR=4,
  isentropicEfficiency=0.85,
  inletArea=0.08,
  outletArea=0.08,
  refPressure=101325,
  refTemperature=288.15,
  mechanicalEff=0.99,
  massFlowDesign=4.727505,
  massFlowCorrected=1.011998)

turbineFPT = struct(
  PR=4.375,
  isentropicEfficiency=0.85,
  refPressure=101325,
  refTemperature=288.15,
  mechanicalEff=0.99,
  inletArea=0.08,
  outletArea=0.08,
  RPMDesign=20900,
  RotorDamping=10,
  massFlowDesign=4.727505,
  massFlowCorrected=3.716863)